# Grasshopper definition inner gear class example.gh (Grasshopper 1.0.7)

number_slider = Slider(14, range=0..100)
number_slider_2 = Slider(37, range=0..100)
number_slider_3 = Slider(4, range=0..100)
number = Number(-2)
subtraction = Subtraction(A=number_slider_2, B=number_slider)
division = Division(A=number_slider_3, B=number)
rectangle = Rectangle(Plane=PlaneXY(0, 0, 0), XSize=number_slider_3, YSize=number_slider, Radius=0)  # -> Rectangle, Length
vector_xyz = VectorXYZ(XComponent=division, YComponent=subtraction, ZComponent=0)  # -> Vector, Length
move = Move(Geometry=rectangle.Rectangle, Motion=vector_xyz.Vector)  # -> Geometry, Transform
polar_array = PolarArray(Geometry=move.Geometry, Plane=PlaneXY(0, 0, 0), Count=Slider(6, range=-1..10), Angle=6.283185307)  # -> Geometry, Transform
circle = Circle(Plane=PlaneXY(0, 0, 0), Radius=number_slider_2)
trim_with_regions = TrimWithRegions(Curve=circle, Regions=polar_array.Geometry)  # -> Inside, Outside
trim_with_regions_2 = TrimWithRegions(Curve=polar_array.Geometry, Regions=circle)  # -> Inside, Outside
join_curves = JoinCurves(Curves=flatten([trim_with_regions_2.Inside, trim_with_regions.Outside]), Preserve=False)
