# Grasshopper definition n-sided polygon with n cuts.gh (Grasshopper 1.0.7)

# Size of the polygon (measured from center to polygon point)
# Number of sides in polygon
circumcircle_radius = Slider(31, range=5..100)
sides = Slider(8, range=3..100)
rect_height = Slider(4, range=1..100)
# Depth of slot in polygon
# Width of slot in polygon, should correspond to material thickness
rect_length = Slider(-6, range=-100..-2)
pi = Pi(Factor=1)
# Center the rectangle (long ways) over the x axis for the plane. This makes sure the center of the rectangle (long ways) is perpendicular to the center of the line it will cut
division = Division(A=rect_height, _2=-2)
# Calculating angle to rotate the slot
division_2 = Division(A=pi, Sides=sides)

# ---- group: Bounding box of the polygon
# Space between shapes on the canvas
space_apart = Slider(1, range=0..30)
# Create bounding box of polygon to spread multiple polygons over an array
multiplication = Multiplication(A=circumcircle_radius, B=2)
addition = Addition(LengthOfPolygon=multiplication, SpaceApart=space_apart)
rectangle = Rectangle(Plane=PlaneXY(0, 0, 0), XSize=addition, YSize=addition, Radius=0)  # -> BoundingBox, Length

# ----
# Clusters - double click to open
# https://www.youtube.com/watch?v=2k2S6FCfjIc&t=395s
ri_via_rc = RiViaRc(radius_of_circumcircle=circumcircle_radius, number_of_sides_on_polygon=sides)
rectangle_2 = Rectangle(Plane=PlaneXY(0, 0, 0), XSize=rect_length, YSize=rect_height, Radius=0)  # -> Rectangle, Length
polygon = Polygon(Plane=PlaneXY(0, 0, 0), Radius=circumcircle_radius, Segments=sides, FilletRadius=0)  # -> Polygon, Length
# Shift a tiny amount outwards in order to create an intersection to trim the slice
addition_2 = Addition(A=0.05, B=ri_via_rc)
vector_xyz = VectorXYZ(XComponent=addition_2, YComponent=division, ZComponent=0)  # -> Vector, Length
# Grabs the center of the polygon so we can rotate around it
# 
# https://www.youtube.com/watch?v=QMI-sy0Dksg
area = Area(Geometry=polygon.Polygon)  # -> Area, Centroid
move = Move(Geometry=rectangle_2.Rectangle, Motion=vector_xyz.Vector)  # -> Geometry, Transform
rotate = Rotate(Geometry=move.Geometry, Angle=division_2, Plane=area.Centroid)  # -> Geometry, Transform
polar_array = PolarArray(Geometry=rotate.Geometry, Plane=PlaneXY(0, 0, 0), Count=sides, Angle=6.283185307)  # -> Geometry, Transform

# ---- group: Cutting rectangles out of polygon
# Flatten curve input to join all curves to single curve
# 
# https://www.grasshopper3d.com/forum/topics/join-curves-1
trim_with_regions = TrimWithRegions(Curve=polar_array.Geometry, Regions=polygon.Polygon)  # -> Inside, Outside
trim_with_regions_2 = TrimWithRegions(Curve=polygon.Polygon, Regions=polar_array.Geometry)  # -> Inside, Outside
join_curves = JoinCurves(Curves=flatten([trim_with_regions.Inside, trim_with_regions_2.Outside]), Preserve=False)

# ----
# Count of shapes to create in X and Y plane
number_slider = Slider(2, range=1..100)
extrude_capped_in_z = ExtrudeCappedInZ(curve=join_curves, value=rect_height)
# Creating multiple shapes for laser cutting
rectangular_array = RectangularArray(Geometry=extrude_capped_in_z, Cell=rectangle.BoundingBox, XCount=Slider(5, range=1..100), YCount=number_slider)  # -> Geometry, Transform

# ==== cluster RiViaRc: Calculate radius of inner circle Ri by means of radius of circumcircle Rc for a regular polygon.
number_of_sides_on_polygon = ClusterInput()
# Ri = Rc cos(pi/n)
# Ri is inner circle radius
# Rc is circumcircle radius
# n is number of sides on the regular polygon
# 
# https://calcresource.com/geom-ngon.html
pi = Pi(Factor=1)
division = Division(Pi=pi, NumberOfSidesOnPolygon=number_of_sides_on_polygon)
radius_of_circumcircle = ClusterInput()
cosine = Cosine(Value=division)
multiplication = Multiplication(RadiusOfCircumcircle=radius_of_circumcircle, B=cosine)
ri = ClusterOutput(multiplication)

# ==== cluster ExtrudeCappedInZ
value = ClusterInput()
unit_z = UnitZ(Factor=value)
curve = ClusterInput()
extrude = Extrude(Curve=curve, Direction=unit_z)
cap_holes = CapHoles(Brep=extrude)
brep = ClusterOutput(cap_holes)
