# Grasshopper definition shoulder fabric design radial.gh (Grasshopper 1.0.7)

panel = Panel("Radius of circle")
number_slider = Slider(60, range=10..1000)
point = Point(<point referenced from the Rhino model>)

# ---- group: Radial grid
# Rows in the circle
number_slider_2 = Slider(7, range=1..100)
# Columns in the circle
number_slider_3 = Slider(38, range=1..100)
division = Division(A=number_slider, B=number_slider_2)
radial = Radial(Plane=point, Size=division, ExtentR=number_slider_2, ExtentP=number_slider_3)  # -> Cells, Points

# ----
circle = Circle(Plane=point, Radius=number_slider)

# ---- group: Create box for trimming semicircle
point_on_curve = PointOnCurve(circle, parameter=0.5)
point_on_curve_2 = PointOnCurve(circle, parameter=1)
multiplication = Multiplication(A=number_slider, B=Slider(2, range=0..10))
line = Line(StartPoint=point_on_curve, EndPoint=point_on_curve_2)
rectangle = Rectangle(Plane=point_on_curve, XSize=multiplication, YSize=multiplication, Radius=0)  # -> Rectangle, Length

# ----
panel_2 = Panel("Arbitrary scaling factor")

# ---- group: Scaling by a factor of distance from the center of semicircle
distance = Distance(PointA=point, PointB=radial.Points)  # -> flatten(Distance)

# ---- group: Scaling by a factor of distance from the center of semicircle / Filter out 0s from the list
larger_than = LargerThan(FirstNumber=distance, SecondNumber=Slider(0, range=0..100))  # -> LargerThan, OrEqualTo
cull_pattern = CullPattern(List=distance, CullPattern=larger_than.LargerThan)

# ---- group: Scaling by a factor of distance from the center of semicircle (continued)
multiplication_2 = Multiplication(A=cull_pattern, B=Slider(0.1017, range=-0.5..0.5))
scale = Scale(Geometry=radial.Cells, Center=radial.Points, Factor=multiplication_2)  # -> Geometry, Transform
panel_3 = Panel(multiplication_2)

# ---- group: Trimming to semicircle
trim_with_region = TrimWithRegion(Curve=[circle, scale.Geometry], Region=rectangle.Rectangle)  # -> Inside, Outside

# ----
curve = Curve(flatten([trim_with_region.Outside, line]))
