# Grasshopper definition shoulder fabric design rectangles.gh (Grasshopper 1.0.7)

number_slider = Slider(5, range=1..1000)
number_slider_2 = Slider(18, range=1..1000)
panel = Panel("Rectangular Grid")
point = Point(<point referenced from the Rhino model>)
# Size of rectangle to fill
number_slider_3 = Slider(60, range=10..1000)
number_slider_4 = Slider(50, range=10..1000)
division = Division(A=number_slider_3, B=number_slider)
rectangle = Rectangle(Plane=point, XSize=number_slider_3, YSize=number_slider_4, Radius=0)  # -> Rectangle, Length
division_2 = Division(A=number_slider_4, B=number_slider_2)
rectangular = Rectangular(Plane=point, SizeX=number_slider, SizeY=number_slider_2, ExtentX=division, ExtentY=division_2)  # -> Cells, Points
# Rectangles inside the grid
number_slider_5 = Slider(3, range=1..200)
rectangle_2 = Rectangle(Plane=rectangular.Points, XSize=number_slider_5, YSize=Slider(15, range=1..200), Radius=0)  # -> Rectangle, Length
trim_with_region = TrimWithRegion(Curve=rectangle_2.Rectangle, Region=rectangle.Rectangle)  # -> Inside, Outside
cluster = Cluster(curve=rectangle_2.Rectangle, value=1)
cluster_2 = Cluster(curve=cluster, value=Slider(4, range=0..10))

# ==== cluster Cluster
value = ClusterInput()
unit_z = UnitZ(Factor=value)
curve = ClusterInput()
extrude = Extrude(Curve=curve, Direction=unit_z)
cap_holes = CapHoles(Brep=extrude)
brep = ClusterOutput(cap_holes)
