# Grasshopper definition sleeve.gh (Grasshopper 1.0.7)

# ---- group: Drawing triangles/ellipses
# Y top corner of triangle
# X out to the right
number_slider = Slider(10, range=-20..20)
panel = Panel("Number of triangles/ellipses")
negative = Negative(Value=number_slider)
series = Series(Start=1, Step=1, Count=Slider(10, range=0..300))
expression = Expression(x=series, y=negative, Expression="y*x*2")
expression_2 = Expression(x=series, y=number_slider, Expression="y*x*2")
expression_3 = Expression(x=Slider(94, range=10..500), y=series, Expression="y*x")
panel_2 = Panel(expression)
panel_3 = Panel(expression_2)
construct_point = ConstructPoint(XCoordinate=0, YCoordinate=expression, ZCoordinate=0)
panel_4 = Panel(expression_3)
construct_point_2 = ConstructPoint(XCoordinate=0, YCoordinate=expression_2, ZCoordinate=0)
construct_point_3 = ConstructPoint(XCoordinate=expression_3, YCoordinate=0, ZCoordinate=0)
inellipse = InEllipse(CornerA=construct_point, CornerB=construct_point_2, CornerC=construct_point_3)  # -> Ellipse, Plane

# ----
panel_5 = Panel("Arbitrary scaling")
# Arbitrary offset distance to create shape
number_slider_2 = Slider(-20.3, range=-500..500)
scale_nu = ScaleNU(
    Geometry=inellipse.Ellipse,
    Plane=PlaneXY(0, 0, 0),
    ScaleX=Slider(1.9, range=-10..10),
    ScaleY=Slider(3.7, range=-10..10),
    ScaleZ=1)  # -> flatten(Geometry), Transform
offset_curve = OffsetCurve(Curve=scale_nu.Geometry, Distance=number_slider_2, Corners=1)  # -> flatten(Curve)
# Original ellipses (for baking on a separate layer)
scale = Scale(Geometry=scale_nu.Geometry, Center=Point(0, 0, 0), Factor=0.5)  # -> Geometry, Transform
panel_6 = Panel("Combined shape")
scale_2 = Scale(Geometry=[scale_nu.Geometry, offset_curve], Center=Point(0, 0, 0), Factor=0.5)  # -> Geometry, Transform
# Offset ellipses (for baking on a separate layer)
scale_3 = Scale(Geometry=offset_curve, Center=Point(0, 0, 0), Factor=0.5)  # -> Geometry, Transform
