# Grasshopper definition snowflake.gh (Grasshopper 1.0.7)

# Amount to push the arm inside the center polygon
number_slider = Slider(11, range=2..20)
number_slider_2 = Slider(6, range=3..10)
number_slider_3 = Slider(73, range=3..100)
panel = Panel("""Polygon size
& Polygon shape""")
panel_2 = Panel("Snowflake arm length")
subtraction = Subtraction(A=number_slider_3, B=number_slider)
unit_x = UnitX(Factor=subtraction)
point = Point(unit_x)
unit_x_2 = UnitX(Factor=Slider(110, range=5..200))
polygon = Polygon(Plane=PlaneXY(0, 0, 0), Radius=number_slider_3, Segments=number_slider_2, FilletRadius=0)  # -> Polygon, Length
move = Move(Geometry=point, Motion=unit_x_2)  # -> Geometry, Transform
line = Line(StartPoint=point, EndPoint=move.Geometry)

# ---- group: Snowflake Fingers
# distance of first snowflake finger from center polygon's point
# multiplier of distance between fingers
number_slider_4 = Slider(6, range=0..50)
unit_x_3 = UnitX(Factor=number_slider_4)
panel_3 = Panel("finger's length")
number_slider_5 = Slider(31, range=0..50)
move_2 = Move(Geometry=point, Motion=unit_x_3)  # -> Geometry, Transform
vector_xyz = VectorXYZ(XComponent=number_slider_5, YComponent=number_slider_5, ZComponent=0)  # -> Vector, Length
move_3 = Move(Geometry=move_2.Geometry, Motion=vector_xyz.Vector)  # -> Geometry, Transform
line_2 = Line(StartPoint=move_2.Geometry, EndPoint=move_3.Geometry)
multiplication = Multiplication(A=number_slider_4, B=Slider(2.9, range=0..5))
unit_x_4 = UnitX(Factor=multiplication)
move_4 = Move(Geometry=line_2, Motion=unit_x_4)  # -> Geometry, Transform
move_5 = Move(Geometry=move_4.Geometry, Motion=unit_x_4)  # -> Geometry, Transform
number_slider_6 = Slider(4.2, range=0..5)
panel_4 = Panel("extended finger length")
end_points = EndPoints(Curve=move_5.Geometry)  # -> Start, End
end_points_2 = EndPoints(Curve=move_4.Geometry)  # -> Start, End
panel_5 = Panel("additional finger length")
scale = Scale(Geometry=move_4.Geometry, Center=end_points_2.Start, Factor=number_slider_6)  # -> Geometry, Transform
addition = Addition(A=number_slider_6, B=Slider(0.4, range=0..1))
scale_2 = Scale(Geometry=move_5.Geometry, Center=end_points.Start, Factor=addition)  # -> Geometry, Transform
curve = Curve(flatten([scale.Geometry, scale_2.Geometry, line_2]))
mirror_curve = MirrorCurve(Geometry=curve, Curve=line, Tangent=True)

# ----
number_slider_7 = Slider(18, range=1..100)
panel_6 = Panel("Outer polygon size")
integer = Integer(move.Geometry)
addition_2 = Addition(A=number_slider_7, B=integer)
polygon_2 = Polygon(Plane=PlaneXY(0, 0, 0), Radius=number_slider_7, Segments=number_slider_2, FilletRadius=0)  # -> Polygon, Length
subtraction_2 = Subtraction(A=addition_2, B=number_slider)
unit_x_5 = UnitX(Factor=subtraction_2)
move_6 = Move(Geometry=polygon_2.Polygon, Motion=unit_x_5)  # -> Geometry, Transform
area = Area(Geometry=move_6.Geometry)  # -> Area, Centroid
rotate = Rotate(Geometry=move_6.Geometry, Angle=degrees(180), Plane=area.Centroid)  # -> Geometry, Transform

# ----
# Offset the shapes to create something with thickness that could be cut with a laser or extruded with volume
# "Fatness" of the snowflake. Offset of each edge from the center of the shape.
number_slider_8 = Slider(10, range=0..10)
curve_2 = Curve(flatten([curve, mirror_curve, line]))
offset_curve = OffsetCurve(Curve=curve_2, Distance=number_slider_8, Corners=1)
negative = Negative(Value=number_slider_8)
offset_curve_2 = OffsetCurve(Curve=curve_2, Distance=negative, Corners=1)
loft = Loft(
    Curves=[offset_curve, offset_curve_2],
    Options={Adjust=False, Closed=False, LoftEnds=0, LoftSimp=0, LoftType=0, Rebuild=10, Refit=0.01})

panel_7 = Panel("Fillet radius")
# Union the arm and finger regions first so the fillet only effects those parts and not the end polygons
region_union = RegionUnion(Curves=flatten(loft))
fillet = Fillet(Curve=region_union, Radius=Slider(10, range=0..10))
polar_array = PolarArray(Geometry=[fillet, rotate.Geometry], Plane=PlaneXY(0, 0, 0), Count=number_slider_2, Angle=6.283185307)  # -> Geometry, Transform
region_union_2 = RegionUnion(Curves=flatten([polygon.Polygon, fillet]))
boundary_surfaces = BoundarySurfaces(Edges=[polar_array.Geometry, region_union_2])
region_union_3 = RegionUnion(Curves=flatten(boundary_surfaces))
curve_3 = Curve(region_union_3)
