# Grasshopper definition voronoi vase.gh (Grasshopper 1.0.7)
# plug-ins: Kangaroo2 Components, DendroGH

# ---- group: Vase Creation
# The points your initial line that forms the vase will follow
# Defines the shape of the vase. Can be any type of graph. The shape will follow the graph. For example, linear will create something with a straight edge from the base to the top, while Gaussian will give more of an "hourglass" shape
# Z range, reflects as height
# Steps in the vertical direction. Less will cause "chunkier" sections and more will create a "smoother" curve up toward the Z range.
# Steps needs to be 4 or greater or else the defaults of the nurbs curve component will cause an error in the system (vertices needs to be more than degree, which is 3 by default.)
# Domain start, will correspond with 0 on the graph
# Remaps values from the curve to the attached domain.
# Domain end, will correspond with 1 on the graph
# Domain start and end can be the same number, but cannot both be 0, or else all values from the graph will map to 0, so the shape will not be drawn
number_slider = Slider(1.5, range=0..50)
number_slider_2 = Slider(4, range=4..20)
construct_domain = ConstructDomain(DomainStart=Slider(27, range=0..100), DomainEnd=number_slider)
range = Range(Domain=Slider(200, range=0..200), Steps=number_slider_2)
range_2 = Range(Domain=Domain(0, 1), Steps=number_slider_2)
graph_mapper = GraphMapper(
    range_2,
    x0=0,
    x1=1,
    y0=0,
    y1=1,
    A=5.058824255,
    B=-2.913192956,
    container_name="Linear",
    Graph_x0=0.7489340901,
    Graph_x1=0.6040065885,
    Graph_y0=0.8755329847,
    Graph_y1=0.142370224)
bounds = Bounds(Numbers=graph_mapper)
remap_numbers = RemapNumbers(Value=graph_mapper, Source=bounds, Target=construct_domain)  # -> Mapped, Clipped
construct_point = ConstructPoint(XCoordinate=remap_numbers.Mapped, YCoordinate=0, ZCoordinate=range)
panel = Panel(construct_point)
xy_plane = XYPlane(Origin=Point(0, 0, 0))
nurbs_curve = NurbsCurve(Vertices=construct_point, Degree=3, Periodic=False)  # -> Curve, Length, Domain
line_sdl = LineSDL(Start=xy_plane, Direction=xy_plane, Length=1)
# Enable this component to see non-voronoi vase changes in real time without the dam.
revolution = Revolution(Curve=nurbs_curve.Curve, Axis=line_sdl, Domain=Domain(0, 6.283185307))

# ----
# When you make changes on the left side, you will need to hit the "play" button on the dam to rerun the process.
# While the dam is not required, the right side requires a lot of processing power. Using the dam keeps the system from crashing when making changes.
data_dam = DataDam(DataDataA=revolution, BufferDelay=2500000, BufferMode=0)

# ---- group: Create voronoi pattern
# Find the points where the curves bend (show discontinuity) and then finding center points between those points.
# Number of points to build the voronoi out of. Increasing will create more cells, decreasing will create less cells. Minimum of 3.
# Culling the "bottom" of the open cells by comparing the z values to the multiplier.
# Creates a random pointcloud on the vase geometry.
# Multiplier for cells to be "filled in". A larger number will fill in more cells, a smaller number will have more open cells. Must be between 0 and 0.9 (cannot round up to 1)
number_slider_3 = Slider(25, range=3..200)
populate_geometry = PopulateGeometry(Geometry=data_dam, Count=number_slider_3, Seed=Slider(4, range=0..10))
panel_2 = Panel("Randomly generated points")
panel_3 = Panel(populate_geometry)
dimensions = Dimensions(Surface=data_dam)  # -> UDimension, VDimension
voronoi_3d = Voronoi3D(Points=populate_geometry, Box=data_dam)  # -> Cells, Boundary
brep_brep = BrepBrep(BrepA=data_dam, BrepB=voronoi_3d.Cells)  # -> flatten(Curves), Points
multiplication = Multiplication(A=dimensions.VDimension, B=Slider(0.513, range=0..0.9))
discontinuity = Discontinuity(Curve=brep_brep.Curves, Level=1)  # -> Points, Parameters
average = Average(Input=discontinuity.Points)  # -> flatten(ArithmeticMean)
deconstruct = Deconstruct(Point=average)  # -> XComponent, YComponent, ZComponent
larger_than = LargerThan(FirstNumber=deconstruct.ZComponent, SecondNumber=multiplication)  # -> LargerThan, OrEqualTo
cull_pattern = CullPattern(List=brep_brep.Curves, CullPattern=larger_than.LargerThan)

# ---- group: Get bottom surface of vase
brep_edges = BrepEdges(Brep=data_dam)  # -> Naked, Interior, NonManifold
curve_middle = CurveMiddle(Curve=brep_edges.Naked)
deconstruct_2 = Deconstruct(Point=curve_middle)  # -> XComponent, YComponent, ZComponent
sort_list = SortList(Keys=deconstruct_2.ZComponent, ValuesValuesA=brep_edges.Naked)  # -> Keys, ValuesValuesA
list_item = ListItem(List=sort_list.ValuesValuesA, Index=0, Wrap=True)
boundary_surfaces = BoundarySurfaces(Edges=list_item)

# ----
# Want to cull the top instead so the voronoi is on the bottom? Connect the "smaller than" to the cull pattern instead of the "larger than".
smaller_than = SmallerThan(FirstNumber=deconstruct.ZComponent, SecondNumber=multiplication)  # -> SmallerThan, OrEqualTo

# ---- group: Get bottom "chunk" of the vase where cells were removed
surface_split = SurfaceSplit(Surface=data_dam, Curves=cull_pattern)
area = Area(Geometry=surface_split)  # -> Area, Centroid
sort_list_2 = SortList(Keys=area.Area, ValuesValuesA=surface_split)  # -> Keys, reverse(ValuesValuesA)
list_item_2 = ListItem(List=sort_list_2.ValuesValuesA, Index=0, Wrap=True)

# ----
number_slider_4 = Slider(0.4, range=0.1..1)
# Creates offset size of the volume, making the piece "thicker"
# Voxel size, must be greater than 0, less than 1; also a way to increase "thickness"
number_slider_5 = Slider(4.8, range=0..10)
# Length between points along the curves. Increase to make bigger segments on the curve that will make the lines bumpier, decrease to make the lines smoother. Recommend a max of 1 or else the curve segments will be too far apart and have gaps. Min must be > 0
explode = Explode(Curve=cull_pattern, Recursive=True)  # -> flatten(Segments), Vertices
multiplication_2 = Multiplication(A=number_slider_5, B=number_slider_4)
divide_length = DivideLength(Curve=explode.Segments, Length=Slider(0.18, range=0.1..1))  # -> flatten(Points), Tangents, Parameters
# Mesh fidelity via length of the Trimesh. Lower is more triangles and higher fidelity. Decreasing will require more processing, so minimum is set to 1
number_slider_6 = Slider(3.7, range=1..10)
brep_join = BrepJoin(Breps=flatten([boundary_surfaces, list_item_2]))  # -> Breps, Closed
removeduplicatepts = RemoveDuplicatePts(Points=divide_length.Points, Tolerance=0.01)
# Mesh not visible? Go to Display>Preview Mesh Edges
triremesh = TriRemesh(Geometry=brep_join.Breps, Length=number_slider_6, Iterations=25)  # -> Triangulation, Dual, Creases

# ---- group: Dendro Components: https://www.food4rhino.com/en/app/dendro
create_settings = CreateSettings(VoxelSize=number_slider_4, Bandwidth=Slider(4, range=1..10), Isovalue="0.001", Adaptivity="0")
mesh_to_volume = MeshToVolume(Mesh=triremesh.Triangulation, Settings=create_settings)
points_to_volume = PointsToVolume(Points=removeduplicatepts, PointRadius=multiplication_2, Settings=create_settings)
offset_volume = OffsetVolume(Volume=mesh_to_volume, Distance=multiplication_2)
volume_union = VolumeUnion(Volumes=flatten([offset_volume, points_to_volume]))
smooth_volume = SmoothVolume(Volume=volume_union, Width=Slider(2, range=0..10), Type=Slider(0, range=0..3), Iterations=1)
volume_to_mesh = VolumeToMesh(Volume=smooth_volume, VolumeSettings=create_settings)
